# Dynamo graph ProgressBar.dyn (Dynamo 2.1.0.7500)

# group: Browse to the location of the ProgressBar.dll
file_path = Filename(".\ProgressBar.dll")

# group: Some test input
categories = Categories("OST_Rooms")
all_elements_of_category = ElementsOfCategory(Category=categories)

python_progressbar = Python(IN[0]=file_path, IN[1]=all_elements_of_category)
# ---------- python_progressbar.python (33 lines) ----------
# @didonenov
# Load the Python Standard and DesignScript Libraries
import sys
import clr
clr.AddReference('ProtoGeometry')
from Autodesk.DesignScript.Geometry import *

# Add reference to the ProgressBar.dll 
path = IN[0]
clr.AddReferenceToFileAndPath(path)
from AdnRme import ProgressForm

rooms = IN[1]
result = []
iterations = len(rooms)	#T his is the counter for the ProgessBar

# Implementation
def Main():
	with ProgressForm('Message you want to display', 'Processing {0} elements ...', iterations) as form:
		for room in rooms:
			pass
			if form.getAbortFlag():	# The user can Cancel the execution of the long process
				return 'Aborted by user.\n(Freeze/Run/Unfreeze node to proceed)'
		form.Increment()

message = Main()

# If we failed to run the process, report
if message:
	OUT = message
else:
	OUT = 'Successfully populated %s elements' % str(iterations)
OUT = 0
# ----------------------------------------
